# Dynamo graph 05_Write-CA-Legend.dyn (Dynamo 2.16.2.5624)

# group: Identify Viewports and Types
python_script = Python()  # CPython3
# ---------- python_script.python (49 lines) ----------
# Import Revit API and necessary libraries
import clr
clr.AddReference('RevitServices')
from RevitServices.Persistence import DocumentManager

clr.AddReference('RevitAPI')
from Autodesk.Revit.DB import *

# Ensure the script doesn't crash if `IN` is missing or Revit is not ready
try:
    # Get the current Revit document
    doc = DocumentManager.Instance.CurrentDBDocument

    # Main logic: Process all viewports
    viewport_ids = []
    viewport_names = []
    viewport_types = []
    view_ids = []

    # Filter to get all Viewports in the document
    collector = FilteredElementCollector(doc).OfClass(Viewport)

    for viewport in collector:
        # Get the name of the view associated with the viewport
        view_id = viewport.ViewId
        view = doc.GetElement(view_id)
        viewport_name = view.Name if view else "Unknown Name"

        # Get the type of the viewport by accessing the Element Type Name directly
        type_element = doc.GetElement(viewport.GetTypeId())
        viewport_type_name = type_element.get_Parameter(BuiltInParameter.SYMBOL_NAME_PARAM).AsString() if type_element else "Unknown Type"

        # Append to the output lists
        viewport_ids.append(viewport.Id.IntegerValue)
        viewport_names.append(viewport_name)
        viewport_types.append(viewport_type_name)
        view_ids.append(view_id.IntegerValue if view else "Unknown View ID")

    # Output results to Dynamo
    OUT = {
        "Viewport IDs": viewport_ids,
        "Viewport Names": viewport_names,
        "Viewport Types": viewport_types,
        "View IDs": view_ids
    }

except Exception as e:
    # Gracefully handle errors
    OUT = f"An error occurred: {e}"
# ----------------------------------------

python_script_2 = Python(IN[0]=python_script)  # CPython3
# ---------- python_script_2.python (48 lines) ----------
# Reference Dynamo nodes and necessary Revit API libraries
import clr
clr.AddReference('RevitAPI')
clr.AddReference('RevitServices')
from RevitServices.Persistence import DocumentManager
from Autodesk.Revit.DB import *

# Get the current Revit document
doc = DocumentManager.Instance.CurrentDBDocument

# Input data - using the output from the previous Python script in Dynamo
data = IN[0]  # Assuming IN[0] is the output from the previous script

# Start a transaction to make changes to the document
t = Transaction(doc, "Update Viewport Type")
t.Start()

try:
    # Loop over the data, assuming the viewport type information is in the 4th sublist (index 3)
    view_types = data[0][3]
    
    for index, view_type in enumerate(view_types):
        # If the type is "DSP Comp Ref", change it to "No Label"
        if view_type == "DSP Comp Ref":
            # Update the data structure (for internal consistency)
            view_types[index] = "No Label"

            # Get all Viewport elements in the model
            viewports = FilteredElementCollector(doc).OfClass(Viewport).ToElements()

            # Find the matching viewport and change its type
            for viewport in viewports:
                # Check if this viewport name matches the one to be updated
                if viewport.Name == "DSP Comp Ref":
                    # Change the name to "No Label" (or update type if more appropriate)
                    viewport.get_Parameter(BuiltInParameter.VIEWPORT_LABEL).Set("No Label")
                    print(f"Viewport '{viewport.Id}' updated to 'No Label'.")

    # Commit the transaction after successful modification
    t.Commit()
    print("Viewport type updated successfully.")
except Exception as e:
    # Rollback if any error occurs
    t.RollBack()
    print(f"Error updating viewport type: {e}")

# Output the modified data structure
OUT = data
# ----------------------------------------
watch = Watch(python_script_2)
watch_2 = Watch(python_script)
